# Grasshopper definition GSA Model Generation.gh (Grasshopper 1.0.7)
# plug-ins: GSA, Karamba3D

series = Series(Start=0, Step=1, Count=10)
pt = ConstructPoint(XCoordinate=series, YCoordinate=0, ZCoordinate=0)
yz = YZPlane(Origin=pt)
rectangle = Rectangle(Plane=PlaneXY(0, 0, 0), XSize="-100 to 100", YSize="-100 to 100", Radius=0)  # -> Rectangle, Length
cir = Circle(Plane=yz, Radius=1)
split = SplitWithBrep(Curve=cir, Brep=rectangle.Rectangle)  # -> Curve, Points
rectangle_2 = Rectangle(Plane=PlaneXY(0, 0, 0), XSize="-5 to 5", YSize="-5 to 5", Radius=0)  # -> Rectangle, Length
item = ListItem(List=split.Curve, Index=0, Wrap=True)  # -> flatten(Item)
panel = Panel("25")
loft = Loft(Curves=item, Options={Adjust=False, Closed=False, LoftEnds=0, LoftSimp=0, LoftType=0, Rebuild=10, Refit=0.01})
mesh_uv = MeshSurface(Surface=rectangle_2.Rectangle, UCount="50", VCount="50", Overhang=True, Equalize=False)
mesh_uv_2 = MeshSurface(Surface=loft, UCount="50", VCount="25", Overhang=True, Equalize=False)
mat = CreateMaterial(Material_type="Steel", Design_Code="EN 1993-1-1:2005", Grade="S355")
explode = Explode(Curve=rectangle_2.Rectangle, Recursive=True)  # -> Segments, Vertices
rdpoints = RemoveDuplicatePointsKaramba3D(Point=explode.Vertices, LimitDistance=0.005)  # -> OutPoint, Info, Indexes
prop2d = Create2DProperty(Thickness_cm="2", Material=mat, Type="Shell", Unit="cm")
loadcase = CreateLoadCase(CaseID="1", Name="DL", Type="Dead")
support = CreateSupport(Point=rdpoints.OutPoint, Plane=PlaneXY(0, 0, 0), x=True, xx=False, y=True, yy=False, z=True, zz=False)
elem2d = Create2DElement(Geometry=mesh_uv, Property2D=prop2d, Preview3dSection=False)
faceload = CreateFaceLoad(
    LoadCase=loadcase,
    Loadable2DObjects=elem2d,
    Axis=-1,
    Direction="z",
    Projected=False,
    Value_kN_m²="-1",
    Type="Uniform",
    Unit="kN/m²")
σt = CreateAnalysisTask(casesParamIndex=2, Solver="Static")
panel_2 = Panel("C:\Users\Matt C\Documents\GitHub\PrincipalStressLines\Example Files\GSA  Model.gwb")
model = CreateModel(
    GSAGeometryIn_m=flatten([support, elem2d]),
    Load=faceload,
    AnalysisTasksCombinations=σt,
    ReMesh=True,
    Tolerance=0.01,
    Unit="m")
save = SaveGSAModel(GSAModel=model, Save=True, FileAndPath=panel_2)
